# Grasshopper definition identify_substructures.gh (Grasshopper 1.0.7)
# plug-ins: RhinoCodePluginGH, Pufferfish, Human

buildings = Brep([<brep referenced from the Rhino model> x1720])
substructure_areas = CSharpScript(Building=buildings)  # -> out, Floors, Walls, PitchedRoofs, FlatRoofs, FloorArea, WallArea, FlatRoofArea, PitchedRoofArea, RoofType; inputs Building: Brep
# ---------- substructure_areas: C# ----------
// Grasshopper Script Instance
using System;
using System.Collections;
using System.Collections.Generic;
using System.Drawing;
using System.Linq;

using Rhino;
using Rhino.Geometry;

using Grasshopper;
using Grasshopper.Kernel;
using Grasshopper.Kernel.Data;
using Grasshopper.Kernel.Types;

public class Script_Instance : GH_ScriptInstance
{
  /* 
    Members:
      RhinoDoc RhinoDocument
      GH_Document GrasshopperDocument
      IGH_Component Component
      int Iteration

    Methods (Virtual & overridable):
      Print(string text)
      Print(string format, params object[] args)
      Reflect(object obj)
      Reflect(object obj, string method_name)
  */
  
  private void RunScript(
	Brep Building,
	ref object Floors,
	ref object Walls,
	ref object PitchedRoofs,
	ref object FlatRoofs,
	ref object FloorArea,
	ref object WallArea,
	ref object FlatRoofArea,
	ref object PitchedRoofArea,
	ref object RoofType)
  {
    // Write your logic here
    List <Brep> allFaces = new List<Brep>();
    List <Vector3d> allNormals = new List<Vector3d>();
    List <Brep> floors = new List<Brep>();
    List <Brep> walls = new List<Brep>();
    List <Brep> flatRoofs = new List<Brep>();
    List <Brep> pitchedRoofs = new List<Brep>();
    List <double> floorArea = new List<double>();
    List <double> wallArea = new List<double>();
    List <double> flatRoofArea = new List<double>();
    List <double> pitchedRoofArea = new List<double>();

    foreach (var face in Building.Faces)
    {
        allNormals.Add(face.NormalAt(0.5, 0.5));
        allFaces.Add(face.DuplicateFace(false));
    }

    for(int i = 0; i < allNormals.Count ; i++){
        Vector3d Z = Vector3d.ZAxis;
        double angle = Vector3d.VectorAngle(allNormals[i], Z);

        if (angle > Math.PI - 0.05 && angle < Math.PI + 0.05){
            floors.Add(allFaces[i]);
            floorArea.Add(allFaces[i].GetArea());
        }
        else if(angle > 0.5 * Math.PI - 0.05 && angle < 0.5 * Math.PI + 0.05){
            walls.Add(allFaces[i]);
            wallArea.Add(allFaces[i].GetArea());
        }
        else if(angle > -0.05 &&  angle < 0.05 ){
            flatRoofs.Add(allFaces[i]);
            flatRoofArea.Add(allFaces[i].GetArea());
        }
        else{
            pitchedRoofs.Add(allFaces[i]);
            pitchedRoofArea.Add(allFaces[i].GetArea());
        }
    }

    Floors = floors;
    Walls = walls;
    PitchedRoofs = pitchedRoofs;
    FlatRoofs = flatRoofs;
    FloorArea = floorArea.Sum();
    WallArea = wallArea.Sum();
    FlatRoofArea = flatRoofArea.Sum();
    PitchedRoofArea = pitchedRoofArea.Sum();

    if ((pitchedRoofArea.Sum()) == 0) {
        RoofType = "Flat Roof";
    } 
    else {
        RoofType = "Pitched Roof";
    }
  }
}
# ---------- end substructure_areas ----------
listdexs = ListIndices(List=buildings)
mesh = Mesh()
concat = Concatenate(FragmentA="B#:", FragmentB=listdexs)
concat_2 = Concatenate(FragmentA="Floor Area:")
concat_3 = Concatenate(FragmentA="Wall Area:")
concat_4 = Concatenate(FragmentA="Flat Roof Area:")
concat_5 = Concatenate(FragmentA="Pitched Roof Area:")
concat_6 = Concatenate(FragmentA="Roof Type:")
concat_7 = Concatenate(FragmentA=concat, FragmentB=concat_2, FragmentC=concat_3, FragmentD=concat_4, FragmentE=concat_5, FragmentK=concat_6)
area = Area(Geometry=buildings)  # -> Area, Centroid
Z = UnitZ(Factor=1)
Y = UnitY(Factor=Slider(16, range=0..100))
move = Move(Motion=Z)  # -> Geometry, Transform
move_2 = Move(Geometry=move.Geometry, Motion=Y)  # -> Geometry, Transform
screentext = ScreenOrientedText(
    Font="Arial",
    Justification=7,
    Location=move_2.Geometry,
    SizeFactor=Slider(0, range=0..10),
    Color=ColourSwatch(SwatchColor=RGB(59, 57, 255)),
    Depth=0,
    Absolute=False)
