# Grasshopper definition identify_substructures_.gh (Grasshopper 1.0.7)
# plug-ins: Pufferfish, Human

buildings = Brep([<brep referenced from the Rhino model> x1568])
segregate_substructures = CSharpScript(Building=buildings)  # -> out, Floors, Walls, PitchedRoofs, FlatRoofs, FloorArea, WallArea, FlatRoofArea, PitchedRoofArea, RoofType; inputs Building: Brep
# ---------- segregate_substructures: C# usings ----------
using System.Drawing;
using System.Linq;
# ---------- segregate_substructures: C# ----------
    List <Brep> allFaces = new List<Brep>();
    List <Vector3d> allNormals = new List<Vector3d>();
    List <Brep> floors = new List<Brep>();
    List <Brep> walls = new List<Brep>();
    List <Brep> flatRoofs = new List<Brep>();
    List <Brep> pitchedRoofs = new List<Brep>();
    List <double> floorArea = new List<double>();
    List <double> wallArea = new List<double>();
    List <double> flatRoofArea = new List<double>();
    List <double> pitchedRoofArea = new List<double>();

    foreach (var face in Building.Faces)
    {
      allNormals.Add(face.NormalAt(0.5, 0.5));
      allFaces.Add(face.DuplicateFace(false));
    }

    for(int i = 0; i < allNormals.Count ; i++){
      Vector3d Z = Vector3d.ZAxis;
      double angle = Vector3d.VectorAngle(allNormals[i], Z);

      if (angle > Math.PI - 0.05 && angle < Math.PI + 0.05){
        floors.Add(allFaces[i]);
        floorArea.Add(allFaces[i].GetArea());
      }
      else if(angle > 0.5 * Math.PI - 0.05 && angle < 0.5 * Math.PI + 0.05){
        walls.Add(allFaces[i]);
        wallArea.Add(allFaces[i].GetArea());
      }
      else if(angle > -0.05 && angle < 0.05 ){
        flatRoofs.Add(allFaces[i]);
        flatRoofArea.Add(allFaces[i].GetArea());
      }
      else{
        pitchedRoofs.Add(allFaces[i]);
        pitchedRoofArea.Add(allFaces[i].GetArea());
      }
    }

    Floors = floors;
    Walls = walls;
    PitchedRoofs = pitchedRoofs;
    FlatRoofs = flatRoofs;
    FloorArea = floorArea.Sum();
    WallArea = wallArea.Sum();
    FlatRoofArea = flatRoofArea.Sum();
    PitchedRoofArea = pitchedRoofArea.Sum();

    if ((pitchedRoofArea.Sum()) == 0) {
      RoofType = "Flat Roof";
    }
    else {
      RoofType = "Pitched Roof";
    }
# ---------- end segregate_substructures ----------
listdexs = ListIndices(List=buildings)
floors = Brep(flatten(segregate_substructures.Floors))
walls = Brep(flatten(segregate_substructures.Walls))
pitched_roofs = Brep(flatten(segregate_substructures.PitchedRoofs))
flat_roofs = Brep(flatten(segregate_substructures.FlatRoofs))
concat = Concatenate(FragmentA="B#:", FragmentB=listdexs)
concat_2 = Concatenate(FragmentA="Floor Area:", FragmentB=segregate_substructures.FloorArea)
concat_3 = Concatenate(FragmentA="Wall Area:", FragmentB=segregate_substructures.WallArea)
concat_4 = Concatenate(FragmentA="Flat Roof Area:", FragmentB=segregate_substructures.FlatRoofArea)
concat_5 = Concatenate(FragmentA="Pitched Roof Area:", FragmentB=segregate_substructures.PitchedRoofArea)
concat_6 = Concatenate(FragmentA="Roof Type:", FragmentB=segregate_substructures.RoofType)
preview = CustomPreview(Geometry=floors, Material=ColourSwatch(SwatchColor=RGB(72, 175, 255)))
preview_2 = CustomPreview(Geometry=walls, Material=ColourSwatch(SwatchColor=RGB(181, 241, 255)))
preview_3 = CustomPreview(Geometry=pitched_roofs, Material=ColourSwatch(SwatchColor=RGB(152, 158, 255)))
preview_4 = CustomPreview(Geometry=flat_roofs, Material=ColourSwatch(SwatchColor=RGB(47, 197, 177)))
concat_7 = Concatenate(FragmentA=concat, FragmentB=concat_2, FragmentC=concat_3, FragmentD=concat_4, FragmentE=concat_5, FragmentK=concat_6)
area = Area(Geometry=buildings)  # -> Area, Centroid
Z = UnitZ(Factor="-10")
move = Move(Geometry=area.Centroid, Motion=Z)  # -> Geometry, Transform
screentext = ScreenOrientedText(
    Text=concat_7,
    Font="Aptos",
    Justification=7,
    Location=move.Geometry,
    SizeFactor=Slider(5, range=0..10),
    Depth=0,
    Absolute=False)
